# Grasshopper definition updated spin rotation.gh (Grasshopper 1.0.7)

rectangle_in_y_between_1_10 = GetNumber(Slider(8, range=0..10), AtLeast=1, AtMost=2147483647, Maximum=1.797693135e+308, Minimum=-1.797693135e+308)
number_of_spin_lines_between_1_100 = GetNumber(Slider(30, range=0..100), AtLeast=1, AtMost=2147483647, Maximum=1.797693135e+308, Minimum=-1.797693135e+308)
diameter_of_the_spin_circle_between_0_1 = GetNumber(Slider(1, range=0..1), AtLeast=1, AtMost=2147483647, Maximum=1.797693135e+308, Minimum=-1.797693135e+308)
rectangle_in_x_between_1_10 = GetNumber(Slider(6, range=0..10), AtLeast=1, AtMost=2147483647, Maximum=1.797693135e+308, Minimum=-1.797693135e+308)
md_slider = MDSlider(SliderMode=0, slider_value=Point(0.5, 0.5, 0.5), x_domain=Domain(0, 1), y_domain=Domain(0, 1), z_domain=Domain(0, 1))
rectangle = Rectangle(Plane=PlaneXY(0, 0, 0), XSize=rectangle_in_x_between_1_10, YSize=rectangle_in_y_between_1_10, Radius=0)  # -> Rectangle, Length
evaluate_surface = EvaluateSurface(Surface=reparameterize(rectangle.Rectangle), Point=md_slider)  # -> Point, Normal, UDirection, VDirection, Frame
circle = Circle(Plane=evaluate_surface.Point, Radius=diameter_of_the_spin_circle_between_0_1)
divide_curve = DivideCurve(Curve=circle, Count=number_of_spin_lines_between_1_100, Kinks=False)  # -> Points, Tangents, Parameters
point_charge = PointCharge(Point=evaluate_surface.Point, Charge=Slider(0.4, range=0..1), Decay=Slider(1.1, range=0..10), Bounds=rectangle.Rectangle)
spin_force = SpinForce(
    Plane=evaluate_surface.Point,
    Strength=Slider(0.2, range=0..1),
    Radius=Slider(5.5, range=0..10),
    Decay=Slider(1.6, range=0..10),
    Bounds=rectangle.Rectangle)
merge_fields = MergeFields(Fields=[point_charge, spin_force])
field_line = FieldLine(Field=merge_fields, Point=divide_curve.Points, Steps=1000, Accuracy=0.1, Method=3)
divide_curve_2 = DivideCurve(Curve=field_line, Count=10, Kinks=False)  # -> Points, Tangents, Parameters
interpolate = Interpolate(Vertices=divide_curve_2.Points, Degree=3, Periodic=False, KnotStyle=1)  # -> Curve, Length, Domain
unit_z = UnitZ(Factor=Slider(0.3, range=0..1))
extrude = Extrude(Base=interpolate.Curve, Direction=unit_z)
context_bake = ContextBake(Geometry=extrude)
